# Dynamo graph CableTray-By-Line-FromCADLayers.dyn (Dynamo 2.6.1.8786)
# packages: bimorphNodes 4.0.3, MEPover 2022.10.30

# group: NODE DETAILS
# note: AUTHOR + COPYRIGHT
# Copyright 2021 Bimorph Consultancy LTD
# Thomas Mahon
# note: CONTACT
# www.bimorph.com
# info@bimorph.com
# @bimorphBIM
# note: PACKAGE NAME
# bimorphNodes
# note: FOLLOW US
# Follow us to get the latest digital engineering news & be the first to hear about bimorphNodes updates:
# FACEBOOK:  facebook.com/bimorphBIM
# LINKEDIN:  linkedin.com/company/bimorph-bim
# TWITTER:  @bimorphBIM

# note: Use this node to select the Import Instance (the CAD Link or Import) from the document
select_model_element = DSModelElementSelection()  # 1 picked in the model; graph input
# note: Copy the String node and click the Litst.Create + button to add more layer names to the list. Layer names are case-sensitive
string = StringInput("Dt3")  # graph input
list_create = List.Create(item0=string)
# note: Set to true to convert lines to Revit Model Lines
boolean = BoolSelector(false)  # graph input
# note: Copy the String node and click the Litst.Create + button to add more LineStyle names to the list. LineStyle names are case-sensitive
string_2 = StringInput("CT3")  # graph input
list_create_2 = List.Create(item0=string_2)
# note: Only the importInstance is a required input. All other inputs are optional and can be left unconnected if not required
curvesFromCADLayers = CAD.CurvesFromCADLayers(importInstance=select_model_element, layerNames=list_create, createModelCurves=boolean, lineStyleMap=list_create_2)
watch = Watch(curvesFromCADLayers.Curve)
element_types = ElementTypes("CableTrayType")
all_elements_of_type = ElementsOfType(element_type=element_types)
code_block = CodeBlock(x=all_elements_of_type) { x[1]; }
code_block_2 = CodeBlock(d=code_block) { d.Name; }
watch_2 = Watch(code_block_2)
name = Element.Name(element=all_elements_of_type)
startPoint = Curve.StartPoint(curve=curvesFromCADLayers.Curve)
endPoint = Curve.EndPoint(curve=curvesFromCADLayers.Curve)
byStartPointEndPoint = Line.ByStartPointEndPoint(startPoint=startPoint, endPoint=endPoint)
flatten = List.Flatten(list=byStartPointEndPoint)
levels = Levels("3F")
code_block_3 = CodeBlock { 100; 1200; }
byLines = Custom[CableTray.ByLines](Lines=flatten, CableTrayType=code_block, level=levels, Width=code_block_3.out1, Height=code_block_3.out0)  # frozen; package MEPover; Creates CableTray by Lines, CableTrayType, Level, Width and Height
code_block_4 = CodeBlock { "SVN_Filter 1"; }
code_block_5 = CodeBlock { "Third Run"; }
setParameterByName = Element.SetParameterByName(element=byLines, parameterName=code_block_4, value=code_block_5)
