# Dynamo graph Grid-By-Line-FromCADLayers.dyn (Dynamo 2.6.1.8786)
# packages: bimorphNodes 3.0.3

# group: NODE DETAILS
# note: AUTHOR + COPYRIGHT
# Copyright 2021 Bimorph Consultancy LTD
# Thomas Mahon
# note: CONTACT
# www.bimorph.com
# info@bimorph.com
# @bimorphBIM
# note: PACKAGE NAME
# bimorphNodes
# note: FOLLOW US
# Follow us to get the latest digital engineering news & be the first to hear about bimorphNodes updates:
# FACEBOOK:  facebook.com/bimorphBIM
# LINKEDIN:  linkedin.com/company/bimorph-bim
# TWITTER:  @bimorphBIM

# note: Use this node to select the Import Instance (the CAD Link or Import) from the document
select_model_element = DSModelElementSelection()  # 1 picked in the model; graph input
string = StringInput("grn-ln")  # graph input
list_create = List.Create(item0=string)
boolean = BoolSelector(false)  # graph input
string_2 = StringInput("grd")  # graph input
list_create_2 = List.Create(item0=string_2)
# note: Only the importInstance is a required input. All other inputs are optional and can be left unconnected if not required
curvesFromCADLayers = CAD.CurvesFromCADLayers(importInstance=select_model_element, layerNames=list_create, createModelCurves=boolean, lineStyleMap=list_create_2)
watch = Watch(curvesFromCADLayers.Curve)
startPoint = Curve.StartPoint(curve=curvesFromCADLayers.Curve)
endPoint = Curve.EndPoint(curve=curvesFromCADLayers.Curve)
byStartPointEndPoint = Line.ByStartPointEndPoint(startPoint=startPoint, endPoint=endPoint)
flatten = List.Flatten(list=byStartPointEndPoint)
byLine = Grid.ByLine(line=flatten)
