# Dynamo graph Pipe-By-Line-FromCADLayers.dyn (Dynamo 2.6.1.8786)
# packages: bimorphNodes 3.0.3, MEPover 2022.10.30

# group: NODE DETAILS
# note: AUTHOR + COPYRIGHT
# Copyright 2021 Bimorph Consultancy LTD
# Thomas Mahon
# note: CONTACT
# www.bimorph.com
# info@bimorph.com
# @bimorphBIM
# note: PACKAGE NAME
# bimorphNodes
# note: FOLLOW US
# Follow us to get the latest digital engineering news & be the first to hear about bimorphNodes updates:
# FACEBOOK:  facebook.com/bimorphBIM
# LINKEDIN:  linkedin.com/company/bimorph-bim
# TWITTER:  @bimorphBIM

# note: Use this node to select the Import Instance (the CAD Link or Import) from the document
select_model_element = DSModelElementSelection()  # 1 picked in the model; graph input
# note: Copy the String node and click the Litst.Create + button to add more layer names to the list. Layer names are case-sensitive
string = StringInput("SPK1-25")  # graph input
list_create = List.Create(item0=string)
boolean = BoolSelector(false)  # graph input
# note: Copy the String node and click the Litst.Create + button to add more LineStyle names to the list. LineStyle names are case-sensitive
string_2 = StringInput("FF")  # graph input
list_create_2 = List.Create(item0=string_2)
# note: Only the importInstance is a required input. All other inputs are optional and can be left unconnected if not required
curvesFromCADLayers = CAD.CurvesFromCADLayers(importInstance=select_model_element, layerNames=list_create, createModelCurves=boolean, lineStyleMap=list_create_2)
watch = Watch(curvesFromCADLayers.Curve)
string_3 = StringInput("CND-40")  # graph input
element_types = ElementTypes("PipeType")
all_elements_of_type = ElementsOfType(element_type=element_types)
code_block = CodeBlock(x=all_elements_of_type) { x[22]; }
code_block_2 = CodeBlock(d=code_block) { d.Name; }
watch_2 = Watch(code_block_2)
startPoint = Curve.StartPoint(curve=curvesFromCADLayers.Curve)
endPoint = Curve.EndPoint(curve=curvesFromCADLayers.Curve)
byStartPointEndPoint = Line.ByStartPointEndPoint(startPoint=startPoint, endPoint=endPoint)
flatten = List.Flatten(list=byStartPointEndPoint)
element_types_2 = ElementTypes("PipingSystemType")
all_elements_of_type_2 = ElementsOfType(element_type=element_types_2)
code_block_3 = CodeBlock(x=all_elements_of_type_2) { x[19]; }
levels = Levels("BM")
# note: Set to true to convert lines to Revit Model Lines
code_block_4 = CodeBlock { 25; }
byLines = Custom[Pipe.ByLines](Lines=flatten, PipeType=code_block, SystemType=code_block_3, level=levels, Diameter=code_block_4)  # package MEPover; Creates a pipe by Line, PipeType, SystemType, Level and Diameter
code_block_5 = CodeBlock(d=code_block_3) { d.Name; }
watch_3 = Watch(code_block_5)
code_block_6 = CodeBlock(d=all_elements_of_type) { d.Name; }
watch_4 = Watch(code_block_6)
code_block_7 = CodeBlock(d=all_elements_of_type_2) { d.Name; }
watch_5 = Watch(code_block_7)
string_4 = StringInput("SVN-SPK2-Duct")  # graph input
code_block_8 = CodeBlock { "22"; "23Duct"; }
code_block_9 = CodeBlock { "19"; "27Duct"; }
