# Dynamo graph Function.dyn (Dynamo 2.18.1.5096)

code_block = CodeBlock { 12; }
if_else = Python(IN[0]=code_block)  # CPython3
# ---------- if_else.python (7 lines) ----------
value = IN[0]
outlist = []
if value%2 == 0:
    outlist.append("Value is even")
else:
    outlist.append("Value is Odd")
OUT = outlist        
# ----------------------------------------
elif_ = Python(IN[0]=code_block)  # CPython3
# ---------- elif_.python (9 lines) ----------
value = IN[0]
outlist = []
if value%2 == 0:
    outlist.append("Divisible by 2")
elif value%3 == 0:
    outlist.append("Divisible by 3")
else:
    outlist.append("not divisible by 2 or 3")
OUT = outlist        
# ----------------------------------------
code_block_2 = CodeBlock { 12; 2; }
try_except = Python(IN[0]=code_block_2.out0, IN[1]=code_block_2.out1)  # CPython3
# ---------- try_except.python (13 lines) ----------
value1 = IN[0]
value2 = IN[1] 
outlist = []
try:
    sum = var1 + var2
    outlist.append(sum)
except:
    outlist.append("Input must be real/int or string")
else:
    outlist.append("Scrpt was successful")
finally:
    outlist.append("Script was run")            
OUT = outlist        
# ----------------------------------------
