# Dynamo graph StringCharacterLocation.dyn (Dynamo 2.6.1.8786)

input_list = CodeBlock { ["a$dsvgv","asdf","gd$df","adf","sfd$asdfgfsd"]; }
code_block = CodeBlock { "asdf"; }
indexOf = List.IndexOf(list=input_list@L2, element=code_block)
string_find_1 = Python(IN[0]=input_list)
# ---------- string_find_1.python (6 lines) ----------
input_list = IN[0]
outlist = []
for string in input_list:
	indicies = string.find("$")
outlist.append(indicies)	
OUT = outlist
# ----------------------------------------
watch = Watch(string_find_1)
output_list_mong_muốn = CodeBlock { [1,0,3,0,4]; }
code_block_2 = CodeBlock { "$"; }
string_cut_left = Python(IN[0]=input_list, IN[1]=code_block_2)
# ---------- string_cut_left.python (21 lines) ----------
# Copyright 2024 Mr Duk ducng.hg@gmail.com
# # Load the Python Standard and DesignScript Libraries
import sys
import clr
clr.AddReference('ProtoGeometry')
from Autodesk.DesignScript.Geometry import *

# The inputs to this node will be stored as a list in the IN variables.
input_list 		 = IN[0]
special_char = IN[1]
outlist = []
# Place your code below this line
for s in input_list:
	if special_char in s:
		string = s.split(special_char)[1]
	else:
		string = s
				
	outlist.append(string)			
# Assign your output to the OUT variable.
OUT = outlist
# ----------------------------------------
watch_2 = Watch(string_cut_left)
watch_3 = Watch(input_list)
code_block_3 = CodeBlock { "abd$dsvv"; }
code_block_4 = CodeBlock { 8; 0; }
substring = String.Substring(str=code_block_3, startIndex=code_block_4.out1, length=code_block_4.out0)
length = String.Length(str=input_list)
code_block_5 = CodeBlock { [1,0,2,0,4]; 0; }
code_block_6 = CodeBlock { 1; }
add = code_block_5.out0 + code_block_6
sub = length - add
