# Dynamo graph ViewToSheet.dyn (Dynamo 2.6.1.8786)

family_types = FamilyTypes("E1 30 x 42 Horizontal:E1 30x42 Horizontal")
code_block = CodeBlock { ["Sheet9","Sheet12","Sheet23"]; ["2001","2002","2003"]; }
create_sheet_by_title_block = Python(IN[0]=family_types, IN[1]=code_block.out0, IN[2]=code_block.out1)
# ---------- create_sheet_by_title_block.python (36 lines) ----------
# Load the Python Standard and DesignScript Libraries
import clr

clr.AddReference('RevitNodes')
import Revit
clr.ImportExtensions(Revit.Elements)
clr.ImportExtensions(Revit.GeometryConversion)
clr.AddReference("RevitServices")
import RevitServices
from RevitServices.Persistence import DocumentManager
from RevitServices.Transactions import TransactionManager
clr.AddReference('RevitAPI')

import Autodesk
from Autodesk.Revit.DB import *
# asf
doc = DocumentManager.Instance.CurrentDBDocument
# The inputs to this node will be stored as a list in the IN variables.
ttb_d = IN[0]
nam_d = IN[1] if isinstance(IN[1], list) else [IN[1]]
num_d = IN[2] if isinstance(IN[2], list) else [IN[2]]

sht_d = []

ttb_r = UnwrapElement(ttb_d).Id
# Place your code below this line
TransactionManager.Instance.EnsureInTransaction(doc)
for na, nu in zip(nam_d, num_d):
	sht = ViewSheet.Create(doc, ttb_r)
	sht.Name = na
	sht.SheetNumber = nu
	sht_d.append(sht.ToDSType(False))
#df
TransactionManager.Instance.TransactionTaskDone()
# Assign your output to the OUT variable.
OUT = sht_d
# ----------------------------------------
