# Dynamo graph Wall-By-Line-FromCADLayers.dyn (Dynamo 2.6.1.8786)
# packages: bimorphNodes 4.0.3

# group: NODE DETAILS
# note: AUTHOR + COPYRIGHT
# Copyright 2021 Bimorph Consultancy LTD
# Thomas Mahon
# note: CONTACT
# www.bimorph.com
# info@bimorph.com
# @bimorphBIM
# note: PACKAGE NAME
# bimorphNodes
# note: FOLLOW US
# Follow us to get the latest digital engineering news & be the first to hear about bimorphNodes updates:
# FACEBOOK:  facebook.com/bimorphBIM
# LINKEDIN:  linkedin.com/company/bimorph-bim
# TWITTER:  @bimorphBIM

# note: Use this node to select the Import Instance (the CAD Link or Import) from the document
select_model_element = DSModelElementSelection()  # 1 picked in the model; graph input
# note: Copy the String node and click the Litst.Create + button to add more layer names to the list. Layer names are case-sensitive
string = StringInput("Dt4")  # graph input
string_2 = StringInput("Dt3")  # graph input
# note: Set to true to convert lines to Revit Model Lines
string_3 = StringInput("Dt2")  # graph input
string_4 = StringInput("Dt1")  # graph input
list_create = List.Create(item0=string, item1=string_2, item2=string_3, item3=string_4)
boolean = BoolSelector(false)  # graph input
# note: Copy the String node and click the Litst.Create + button to add more LineStyle names to the list. LineStyle names are case-sensitive
string_5 = StringInput("CT3")  # graph input
list_create_2 = List.Create(item0=string_5)
# note: Only the importInstance is a required input. All other inputs are optional and can be left unconnected if not required
curvesFromCADLayers = CAD.CurvesFromCADLayers(importInstance=select_model_element, layerNames=list_create, createModelCurves=boolean, lineStyleMap=list_create_2)
watch = Watch(curvesFromCADLayers.Curve)
startPoint = Curve.StartPoint(curve=curvesFromCADLayers.Curve)
endPoint = Curve.EndPoint(curve=curvesFromCADLayers.Curve)
byStartPointEndPoint = Line.ByStartPointEndPoint(startPoint=startPoint, endPoint=endPoint)
flatten = List.Flatten(list=curvesFromCADLayers.Curve)
code_block = CodeBlock { 4000; }
levels = Levels("3F")
element_types = ElementTypes("BeamSystemType")
all_elements_of_type = ElementsOfType(element_type=element_types)
code_block_2 = CodeBlock(x=all_elements_of_type) { x[0]; }
byCurveAndHeight = Wall.ByCurveAndHeight(curve=flatten, height=code_block, level=levels, wallType=code_block_2)  # frozen
element_types_2 = ElementTypes("MechanicalSystemType")
all_elements_of_type_2 = ElementsOfType(element_type=element_types_2)
code_block_3 = CodeBlock(x=all_elements_of_type_2) { x[0]; }
code_block_4 = CodeBlock(d=code_block_3) { d.Name; }
code_block_5 = CodeBlock(d=code_block_2) { d.Name; }
levels_2 = Levels("1F")
levels_3 = Levels("2F")
byCurveAndLevels = Wall.ByCurveAndLevels(curve=flatten, startLevel=levels_2, endLevel=levels_3, wallType=code_block_2)  # frozen
name = Element.Name(element=all_elements_of_type)
watch_2 = Watch(name)
