# Dynamo graph DateTime.dyn (Dynamo 2.6.1.8786)

python_script = Python()  # unwired: IN[0]
# ---------- python_script.python (7 lines) ----------
#from datetime import datetime
#my_today = datetime.now()
x = "which"
y = "formated"
z = 'xxx'
format_1 = "This is a string {} has been positionally {} df {}".format(x,y,z)
OUT = format_1
# ----------------------------------------
watch = Watch(python_script)
