# Dynamo graph FamParaSet.dyn (Dynamo 2.6.1.8786)
# packages: Crumple 1.0.5, ExcelReader 134.1.1

# group: Open Fam Doc
directory_path = Directory("E:\9. Coding\9700_RevitDyn\9710 Lego\Family Share Replace\CPLCA HWP\New folder (2)")
code_block = CodeBlock { ".rfa"; false; }
windows_directorycontents = Custom[© Windows.DirectoryContents](directoryPath=directory_path, searchString=code_block.out0, deepSearch=code_block.out1)  # package Crumple; Be aware there is an OOTB node that can do this, but I wanted to add this to the package so others can see how to use a Python method as a starter block in other scripts.
familydoc_open = Custom[© FamilyDoc.Open](filePaths=windows_directorycontents)  # frozen; package Crumple; Given a file path to a family, attempts to open that document in the background in Revit if possible. Should not be used for regular models/templates.

file_path = Filename("..\9700_RevitDyn\9710 Lego\Family Share Replace\CPLCA HWP\New folder (2)\Book1.xlsx")
file_from_path = FileObject(path=file_path)
code_block_2 = CodeBlock { "Sheet1"; 0; "a2:d10"; true; }
read = EPPlus.ExcelReader.ExcelFile.Read(file=file_from_path, sheetName=code_block_2.out0, range=code_block_2.out2)
fam_para_set = Python(IN[0]=familydoc_open.familyDocs, IN[1]=read)  # unwired: IN[2]
# ---------- fam_para_set.python (39 lines) ----------
# Load the Python Standard and DesignScript Libraries
import clr

clr.AddReference("RevitServices")
import RevitServices
from RevitServices.Persistence import DocumentManager
from RevitServices.Transactions import TransactionManager

clr.AddReference('RevitAPI')
import Autodesk
from Autodesk.Revit.DB import *
# asf
#doc = DocumentManager.Instance.CurrentDBDocument
# The inputs to this node will be stored as a list in the IN variables.
famDocs = IN[1]
famNames = [f.Title for f in famDocs]
#Get all the data we need to support this workflow
famTypesList, famTypeNamesList, famParamsList, famParaNamesList = [], [], [], []

for f in famDocs:
	famMan = f.familyManager
	#get type data
	famTypes = list(famMan.Types)
	typeNames = [f.Name for f in famTypes]
	famTypesList.append(famTypes)
	famTypeNamesList.append(typeNames)
	#get para data
	params = famMan.GetParameters()
	paraNames = [p.Definition.Name for p in params]
	famParamsList.append(params)
	famParaNamesList.append(paraNames)
	
# Place your code below this line
#TransactionManager.Instance.EnsureInTransaction(doc)

#df
#TransactionManager.Instance.TransactionTaskDone()
# Assign your output to the OUT variable.
OUT = 0
# ----------------------------------------
waitFor = Custom[WaitFor](data=familydoc_open.familyDocs, waitFor=fam_para_set)  # package Crumple; Tells the first input to wait for the second input to arrive, then passes on the first input. Really useful for scripts which have branching paths that rely on their outputs to carry each other forward. Quite a few custom packages have a 'passthrough' or 'waitfor' node. I use these all the time, so find it useful to have them contained in this package also.
code_block_3 = CodeBlock { true; }
familydoc_close = Custom[© FamilyDoc.Close](familyDocs=waitFor, saveOption=code_block_3)  # package Crumple; Given documents in the unwrapped state, attempts to close then with the option to save them (applies to all documents, one input expected, not a list).
