# Dynamo graph IfthenElse.dyn (Dynamo 2.6.1.8786)

code_block = CodeBlock { 1..5..1; 6..15..1; }
watch = Watch(code_block.out0)
watch_2 = Watch(code_block.out1)
boolean = BoolSelector(false)
if_then_else_1 = Python(IN[0]=boolean, IN[1]=code_block.out0, IN[2]=code_block.out1)  # frozen
# ---------- if_then_else_1.python (12 lines) ----------
if_bool = IN[0]
then_var = IN[1]
else_var = IN[2]
# The inputs to this node will be stored as a list in the IN variab

# Place your code below this line
if if_bool:
	result = then_var
else:
	result = else_var
# Assign your output to the OUT variable.
OUT = result
# ----------------------------------------
watch_3 = Watch(if_then_else_1)
if_then_else_2 = Python(IN[0]=boolean, IN[1]=code_block.out0, IN[2]=code_block.out1)
# ---------- if_then_else_2.python (4 lines) ----------
if IN[0]:
	OUT = IN[1]
else:
	OUT = IN[2]
# ----------------------------------------
watch_4 = Watch(if_then_else_2)
