# Dynamo graph ListForce.dyn (Dynamo 2.6.1.8786)

code_block = CodeBlock { 5; 1..3..1; }
list_force_2 = Python(IN[0]=code_block.out1)  # frozen
# ---------- list_force_2.python (1 lines) ----------
OUT = IN[0] if isinstance(IN[0], list) else [IN[0]]
# ----------------------------------------
watch = Watch(list_force_2)
watch_2 = Watch(code_block.out1)
list_force = Python(IN[0]=code_block.out1)  # frozen
# ---------- list_force.python (8 lines) ----------
input = IN[0]
check = isinstance(input, list)

if check:
	result = input
else:
	result = [input]
OUT = result
# ----------------------------------------
watch_3 = Watch(list_force)
list_force_3_function = Python(IN[0]=code_block.out0)
# ---------- list_force_3_function.python (5 lines) ----------
def islist(input):
	result = isinstance(input, list)
	result2 = input if result else [input]
	return result2
OUT = islist(IN[0])
# ----------------------------------------
watch_4 = Watch(list_force_3_function)
