# Dynamo graph Regex.dyn (Dynamo 2.6.1.8786)

python_script = Python()  # unwired: IN[0]
# ---------- python_script.python (6 lines) ----------
#from datetime import datetime
#my_today = datetime.now()
import re
x = "123abc"
regex = True if re.search(r"[a-z]+", x) else False
OUT = regex
# ----------------------------------------
watch = Watch(python_script)
