# Dynamo graph StringExplode.dyn (Dynamo 2.18.1.5096)

code_block = CodeBlock { ["String 1", "string5"]; "_"; }
string_explode = Python(IN[0]=code_block.out0, IN[1]=code_block.out1)  # IronPython2
# ---------- string_explode.python (19 lines) ----------
data = IN[0]
sub = IN[1]

if isinstance(data, list):
	strlist = data
else:
	strlist = [data]
	
final = []

for str in strlist:
	chars = []
	for char in str:
		if char == " ":
			chars.append(sub)
		else:
			chars.append(char)
		final.append(chars)
OUT = final		
# ----------------------------------------
code_block_2 = CodeBlock { ["String 1 ", " string 5      ", "      string 5    "]; "_"; }
string_stripped = Python(IN[0]=code_block_2.out0)  # IronPython2
# ---------- string_stripped.python (9 lines) ----------
# Copywright Mr Duk ducng.hg@gmail.com Nov 2024
# Code generated by AI
# Remove Leading and Trailing whitespace
data = IN[0]
final = []
for str in data:
	stripped_chars = str.strip()
	final.append(stripped_chars)
OUT = final		
# ----------------------------------------
length = String.Length(string=string_stripped)
watch = Watch(length)
