# Dynamo graph StringStrip.dyn (Dynamo 2.6.1.8786)

python_script = Python()  # unwired: IN[0]
# ---------- python_script.python (6 lines) ----------
messy = '   string1 String 2  '
clean = messy.strip()
rclean = messy.rstrip()
lclean = messy.lstrip()

OUT = clean, rclean, lclean
# ----------------------------------------
watch = Watch(python_script)
